# Grasshopper definition railing.gh (Grasshopper 1.0.7)

# ---- group: bottom line
vec = Vector(Vector(3252.332836, 0, 0))
pt = Point(<point referenced from the Rhino model>)
line = LineSDL(Start=pt, Direction=vec, Length=Slider(100, range=10..1000))

# ---- group: top line
vec_2 = Vector(Vector(3252.332836, 0, 0))
pt_2 = Point(<point referenced from the Rhino model>)
line_2 = LineSDL(Start=pt_2, Direction=vec_2, Length=Slider(100, range=10..1000))

# ----
offset = OffsetCurve(Distance=1, Plane=PlaneXY(0, 0, 0), Corners=1)
